# Grasshopper definition gh_node_extractor.gh (Grasshopper 1.0.4)

geo = Geometry([<point referenced from the Rhino model> x97])
geo_2 = Geometry(<brep referenced from the Rhino model>)
srf_cp = SurfaceClosestPoint(Point=geo, Surface=geo_2)  # -> Point, UVPoint, Distance
crv = Curve([<curve referenced from the Rhino model> x435])
crv_2 = Curve([<curve referenced from the Rhino model> x864])
geo_3 = Geometry([<point referenced from the Rhino model> x96])
geo_4 = Geometry([<point referenced from the Rhino model> x56])
geo_5 = Geometry([<curve referenced from the Rhino model> x96])
explode = Explode(Curve=crv, Recursive=True)  # -> flatten(Segments), Vertices
evalsrf = EvaluateSurface(Surface=geo_2, Point=srf_cp.UVPoint)  # -> Point, Normal, Frame
end = EndPoints(Curve=geo_5)  # -> Start, End
end_2 = EndPoints(Curve=crv_2)  # -> Start, End
multiplication = Multiplication(A=evalsrf.Normal, B=100)
merge = Merge(Data1=end.Start, Data2=end.End)  # -> flatten(Result)
cullpt = CullDuplicates(Points=geo_4, Tolerance=0.1, CullMode=3)  # -> Points, Indices, Valence
move = Move(Geometry=evalsrf.Point, Motion=multiplication)  # -> Geometry, Transform
merge_2 = Merge(Data1=end_2.Start, Data2=end_2.End)  # -> flatten(Result)
cullpt_2 = CullDuplicates(Points=merge_2, Tolerance=0.1, CullMode=3)  # -> Points, Indices, Valence
larger = LargerThan(FirstNumber=cullpt_2.Valence, SecondNumber=6)  # -> LargerThan, OrEqualTo
cp = ClosestPoint(Point=merge, Cloud=cullpt_2.Points)  # -> ClosestPoint, CPIndex, Distance
cp_2 = ClosestPoint(Point=end_2.Start, Cloud=cullpt_2.Points)  # -> ClosestPoint, CPIndex, Distance
cp_3 = ClosestPoint(Point=end_2.End, Cloud=cullpt_2.Points)  # -> ClosestPoint, CPIndex, Distance
cp_4 = ClosestPoint(Point=cullpt.Points, Cloud=cullpt_2.Points)  # -> ClosestPoint, CPIndex, Distance
vec2pt = Vector2Pt(PointA=end.Start, PointB=end.End, Unitize=True)  # -> Vector, Length
dispatch = Dispatch(List=cullpt_2.Points, DispatchPattern=larger.OrEqualTo)  # -> ListA, ListB
entwine = Entwine(Branch00=cp_2.CPIndex, Branch01=cp_3.CPIndex, FlattenInputs=True)
smaller = SmallerThan(FirstNumber=cp.Distance, SecondNumber=1)  # -> SmallerThan, OrEqualTo
Z = UnitZ(Factor=-1)
pt = Point(dispatch.ListA)
panel = Panel(cullpt_2.Points)
dispatch_2 = Dispatch(List=cp.CPIndex, DispatchPattern=smaller.SmallerThan)  # -> ListA, ListB
flip = FlipMatrix(Data=entwine)
crossref = CrossReference(ListA=Z, ListB=cp_4.CPIndex, CrossMode=1)  # -> ListA, ListB
num2pt = NumbersToPoints(Numbers=flatten(flip), Mask=2)
entwine_2 = Entwine(Branch00=vec2pt.Vector, Branch01=dispatch_2.ListA, FlattenInputs=True)
merge_3 = Merge(Data1=Z, Data2=cp_4.CPIndex)
entwine_3 = Entwine(Branch00=crossref.ListA, Branch01=crossref.ListB, FlattenInputs=True)
graft = GraftTree(Tree=entwine_3, IncludeEmptyLists=True, IncludeNullItems=True)
flip_2 = FlipMatrix(Data=entwine_3)
panel_2 = Panel(num2pt)
flip_3 = FlipMatrix(Data=entwine_2)
panel_3 = Panel(flip_2)
panel_4 = Panel(flip_3)
